# Grasshopper definition dovetail-box.gh (Grasshopper 1.0.7)

cutout_back_wall = Slider(-8, range=-50..50)

# ---- group: Controls
joint_points = Slider(7, range=1..21)
box_width = Slider(223, range=0..300)
dovetail_angle = Slider(10, range=0..90)
wall_thickness = Slider(15, range=0..100)
box_height = Slider(125, range=0..200)

# ---- group: front
unit_x = UnitX(Factor=box_width)
construct_point = ConstructPoint(XCoordinate=0, YCoordinate=0, ZCoordinate=0)
unit_x_2 = UnitX(Factor=cutout_back_wall)
move = Move(Geometry=construct_point, Motion=unit_x_2)  # -> Geometry, Transform
unit_z = UnitZ(Factor=box_height)
unit_x_3 = UnitX(Factor=wall_thickness)
unit_z_2 = UnitZ(Factor=box_height)
move_2 = Move(Geometry=construct_point, Motion=unit_z)  # -> Geometry, Transform
move_3 = Move(Geometry=move.Geometry, Motion=unit_z_2)  # -> Geometry, Transform
line = Line(StartPoint=move.Geometry, EndPoint=move_3.Geometry)
line_2 = Line(StartPoint=construct_point, EndPoint=move_2.Geometry)
divide_curve = DivideCurve(Curve=line_2, Count=joint_points, Kinks=False)  # -> Points, Tangents, Parameters
list_item = ListItem(List=divide_curve.Points, Index=-1, Wrap=True)
rectangle_3pt = Rectangle3Pt(PointA=construct_point, PointB=list_item, PointC=unit_x)  # -> Rectangle, Length
boundary_surfaces = BoundarySurfaces(Edges=rectangle_3pt.Rectangle)
move_4 = Move(Geometry=divide_curve.Points, Motion=unit_x_3)  # -> Geometry, Transform
list_item_2 = ListItem(List=move_4.Geometry, Index=0, Wrap=True)
line_3 = Line(StartPoint=move.Geometry, EndPoint=list_item_2)
list_item_3 = ListItem(List=move_4.Geometry, Index=-1, Wrap=True)
line_4 = Line(StartPoint=move_3.Geometry, EndPoint=list_item_3)
full_list = Panel(move_4.Geometry)
cull_index = CullIndex(List=move_4.Geometry, Indices=[0, -1], Wrap=True)
culled_list = Panel(cull_index)
dispatch = Dispatch(List=move_4.Geometry, DispatchPattern=[True, False])  # -> ListA, ListB
line_dovetail_well = Line(StartPoint=dispatch.ListA, EndPoint=dispatch.ListB)
dispatch_2 = Dispatch(List=cull_index, DispatchPattern=[True, False])  # -> ListA, ListB
even = Panel(dispatch_2.ListA)
odd = Panel(dispatch_2.ListB)
unit_y = UnitY(Factor=wall_thickness)
subtraction = Subtraction(A=90, B=dovetail_angle)
right_trigonometry = RightTrigonometry(Alpha=degrees(dovetail_angle), PLength=wall_thickness)  # -> Alpha, Beta, PLength, QLength, RLength
right_trigonometry_2 = RightTrigonometry(Beta=degrees(subtraction), PLength=wall_thickness)  # -> Alpha, Beta, PLength, QLength, RLength

# ---- group: front / C
unit_x_4 = UnitX(Factor=1)
unit_y_2 = UnitY(Factor=1)
subtraction_2 = Subtraction(A=180, B=dovetail_angle)
rotate = Rotate(Vector=unit_x_4, Axis=unit_y_2, Angle=degrees(subtraction_2))
line_sdl = LineSDL(Start=dispatch_2.ListA, Direction=rotate, Length=right_trigonometry.RLength)

# ---- group: front / A
unit_x_5 = UnitX(Factor=1)
unit_y_3 = UnitY(Factor=1)
addition = Addition(A=180, B=dovetail_angle)
rotate_2 = Rotate(Vector=unit_x_5, Axis=unit_y_3, Angle=degrees(addition))
line_sdl_2 = LineSDL(Start=dispatch_2.ListB, Direction=rotate_2, Length=right_trigonometry_2.RLength)

# ---- group: front (continued)
line_line = LineLine(Line1=line_2, Line2=line_sdl)  # -> ParamA, ParamB, PointA, PointB
line_line_2 = LineLine(Line1=line_2, Line2=line_sdl_2)  # -> ParamA, ParamB, PointA, PointB
line_5 = Line(StartPoint=line_line.PointA, EndPoint=line_line_2.PointB)
join_curves = JoinCurves(Curves=flatten([line, line_4, line_3, line_sdl, line_sdl_2, line_5, line_dovetail_well]), Preserve=False)
boundary_surfaces_2 = BoundarySurfaces(Edges=join_curves)
region_difference = RegionDifference(CurvesA=boundary_surfaces, CurvesB=boundary_surfaces_2)
boundary_surfaces_3 = BoundarySurfaces(Edges=region_difference)
mirror = Mirror(Geometry=boundary_surfaces_2, Plane=PlaneYZ(0, 0, 0))  # -> Geometry, Transform
move_5 = Move(Geometry=mirror.Geometry, Motion=unit_x)  # -> Geometry, Transform
region_difference_2 = RegionDifference(CurvesA=boundary_surfaces_3, CurvesB=move_5.Geometry)
boundary_surfaces_4 = BoundarySurfaces(Edges=region_difference_2)
extrude = Extrude(Base=boundary_surfaces_4, Direction=unit_y)

# ---- group: Cutout 1
unit_x_6 = UnitX(Factor=Slider(-80, range=-100..100))
move_6 = Move(Geometry=join_curves, Motion=unit_x_6)  # -> Geometry, Transform
area = Area(Geometry=move_6.Geometry)  # -> Area, Centroid
yz_plane = YZPlane(Origin=area.Centroid)
rotate_3 = Rotate(Geometry=move_6.Geometry, Angle=1.570796327, Plane=yz_plane)  # -> Geometry, Transform
deconstruct = Deconstruct(Point=area.Centroid)  # -> XComponent, YComponent, ZComponent
cutout_hight = Slider(7, range=0..20)
construct_point_2 = ConstructPoint(XCoordinate=deconstruct.XComponent, YCoordinate=deconstruct.YComponent, ZCoordinate=0)
unit_z_3 = UnitZ(Factor=construct_point_2)
vector_2pt = Vector2Pt(PointA=area.Centroid, PointB=construct_point_2, Unitize=False)  # -> Vector, Length
negative = Negative(Value=construct_point_2)
move_7 = Move(Geometry=rotate_3.Geometry, Motion=vector_2pt.Vector)  # -> Geometry, Transform
boundary_surfaces_5 = BoundarySurfaces(Edges=move_7.Geometry)
unit_z_4 = UnitZ(Factor=cutout_hight)
extrude_2 = Extrude(Base=boundary_surfaces_5, Direction=unit_z_4)

# ---- group: Floor
unit_x_7 = UnitX(Factor=box_width)
move_8 = Move(Geometry=construct_point, Motion=unit_x_7)  # -> Geometry, Transform
negative_2 = Negative(Value=wall_thickness)
unit_z_5 = UnitZ(Factor=negative_2)

# ---- group: left wall
unit_y_4 = UnitY(Factor=box_width)
move_9 = Move(Geometry=construct_point, Motion=unit_y_4)  # -> Geometry, Transform
move_10 = Move(Geometry=list_item, Motion=unit_y_4)  # -> Geometry, Transform
rectangle_3pt_2 = Rectangle3Pt(PointA=construct_point, PointB=move_9.Geometry, PointC=move_10.Geometry)  # -> Rectangle, Length
boundary_surfaces_6 = BoundarySurfaces(Edges=rectangle_3pt_2.Rectangle)
unit_x_8 = UnitX(Factor=wall_thickness)
extrude_3 = Extrude(Base=boundary_surfaces_6, Direction=unit_x_8)

# ---- group: Floor (continued)
rectangle_3pt_3 = Rectangle3Pt(PointA=construct_point, PointB=move_8.Geometry, PointC=move_9.Geometry)  # -> Rectangle, Length
boundary_surfaces_7 = BoundarySurfaces(Edges=rectangle_3pt_3.Rectangle)
extrude_4 = Extrude(Base=boundary_surfaces_7, Direction=unit_z_5)

# ---- group: right wall
subtraction_3 = Subtraction(A=box_width, B=wall_thickness)
unit_x_9 = UnitX(Factor=subtraction_3)

# ---- group: Back wall
unit_y_5 = UnitY(Factor=subtraction_3)
move_11 = Move(Geometry=extrude, Motion=unit_y_5)  # -> Geometry, Transform

# ---- group: left wall (continued)
solid_difference = SolidDifference(BrepsA=extrude_3, BrepsB=[extrude, move_11.Geometry])

# ---- group: right wall (continued)
area_2 = Area(Geometry=solid_difference)  # -> Area, Centroid
rotate_4 = Rotate(Geometry=solid_difference, Angle=degrees(Slider(180, range=0..360)), Plane=area_2.Centroid)  # -> Geometry, Transform
move_12 = Move(Geometry=rotate_4.Geometry, Motion=unit_x_9)  # -> Geometry, Transform
